test file "test_verifier_test"
  coverage: Decision, Condition

suite "New Test Suite 1"

  case "New Test Case 1" [baseline]
    model test_verifier, harness test_verifier_sldvharness (for test_verifier/Liveness)
    input "Counter Example:1" from Liveness_sldvdata1.mat (active)
    input "Design Verifier (Liveness_sldvdata1.mat)" from Liveness_sldvdata1.mat
    iterations:
      Counter Example:1: ExternalInput "Counter Example:1"